# Grasshopper definition 3D.gh (Grasshopper 1.0.7)
# plug-ins: TopOpt-DMS2019

# ----
# Passive elements (optional)
pipeline = GeometryPipeline(
    GroupByLayer=False,
    GroupByType=False,
    IncludeHidden=True,
    IncludeLocked=True,
    LayerFilter="geo",
    NameFilter="*",
    SublayerFiltering=True,
    TypeFilter=4)
pipeline_2 = GeometryPipeline(
    GroupByLayer=False,
    GroupByType=False,
    IncludeHidden=True,
    IncludeLocked=True,
    LayerFilter="geo_passive",
    NameFilter="*",
    SublayerFiltering=True,
    TypeFilter=4)
passive = PassiveElements(PassiveElements=pipeline_2, OtherElements=pipeline, Path="DEFAULT")  # -> Elements, Index, OutputFile

# ----
# Construct model
working_plane = WorkingPlanes({"XY-PLANE": 12, "XZ-PLANE": 13, "YZ-PLANE": 23}, selected="XY-PLANE")
pipeline_3 = GeometryPipeline(
    GroupByLayer=False,
    GroupByType=False,
    IncludeHidden=True,
    IncludeLocked=True,
    LayerFilter="load",
    NameFilter="*",
    SublayerFiltering=True,
    TypeFilter=4)
pipeline_4 = GeometryPipeline(
    GroupByLayer=False,
    GroupByType=False,
    IncludeHidden=True,
    IncludeLocked=True,
    LayerFilter="bc",
    NameFilter="*",
    SublayerFiltering=True,
    TypeFilter=4)
element_type = ElementTypes({"TRUSS": 3, "BEAM": 6}, selected="BEAM")
dimension = Dimension({"2D": 2, "3D": 3}, selected="3D")
preperation = PreperationForTopologyOptimization(
    Elements=passive.Elements,
    BoundaryConditions=pipeline_4,
    Forces=pipeline_3,
    ElementType=element_type,
    WorkingPlane=working_plane,
    Dimension=dimension,
    Path="DEFAULT")  # -> Nodes, Elements, Orientations, ElementSet, Layers, OutputFiles

# ----
# Advanced settings (optional)
number_slider = Slider(1000, range=0..1000)
filtering_approach = FilteringApproach({"SENS": 1, "DENS": 2}, selected="SENS")
set = AdvancedSettingsComponent(
    PenalizationFactor=Slider(3, range=1..5),
    MoveLimit=Slider(0.2, range=0..1),
    Tolerance=Slider(0.001, range=0..0.001),
    MaximumIterations=number_slider,
    FilteringApproach=filtering_approach,
    Continuation=Toggle(True))

# ----
# Run the topology optimization program
number_slider_2 = Slider(4, range=0..10)
run = RunTheTopologyOptimizationProgram(
    VolumeFraction=Slider(0.5, range=0..1),
    MinimumLength=Slider(50, range=0..100),
    CrossSectionWidth=number_slider_2,
    CrossSectionHeight=Slider(0.6, range=0..10),
    ElementType=element_type,
    Passive=Toggle(False),
    AdvancedSettings=set,
    SaveDensities=Toggle(False),
    Path="DEFAULT",
    Run=Button(),
    PythonCaller="python")

# ----
# Example of how to filter the output to see the different orientations / layers
number_slider_3 = Slider(0, range=0..5)
equals = Equality(FirstNumber=preperation.Orientations, SecondNumber=number_slider_3)  # -> Equality, Inequality
cull = CullPattern(List=preperation.Elements, CullPattern=equals.Equality)
Y = UnitY(Factor=Slider(160, range=0..500))
move = Move(Geometry=cull, Motion=Y)  # -> Geometry, Transform

# ----
# Scan
button = Button()
scan = SearchScanAllTheTopologyOptimizationFiles(Path="DEFAULT", Scan=button)

# ----
# Delete (be carefull..)
button_2 = Button()
del = DeleteTheSelectedTopologyOptimizationFiles(Files=scan, Delete=button_2)  # -> DeletedFiles, Failed

# ----
# Find and delete all the saved files
panel = Panel(scan)
panel_2 = Panel(del.DeletedFiles)
panel_3 = Panel(del.Failed)

# ----
# Read and visualize the topology optimization results
button_3 = Button()
read = ReadTheTopologyOptimizationResults(Path="DEFAULT", Run=button_3, Iteration=-1)  # -> Densities, ReadedFile
X = UnitX(Factor=Slider(160, range=0..500))

# ----
# Threshold (black and white filtering)
number_slider_4 = Slider(0.5, range=0..1)
larger = LargerThan(FirstNumber=read.Densities, SecondNumber=number_slider_4)  # -> LargerThan, OrEqualTo

cull_2 = CullPattern(List=preperation.Elements, CullPattern=larger.LargerThan)
move_2 = Move(Geometry=cull_2, Motion=X)  # -> Geometry, Transform
