# Grasshopper definition GRASSHOPPER.gh (Grasshopper 1.0.7)
# plug-ins: DMS2019, Human

geometry = GeometryPipeline(
    GroupByLayer=False,
    GroupByType=False,
    IncludeHidden=True,
    IncludeLocked=True,
    LayerFilter="layer_01",
    NameFilter="*",
    SublayerFiltering=True,
    TypeFilter=5)  # disabled
geometry_2 = GeometryPipeline(
    GroupByLayer=False,
    GroupByType=False,
    IncludeHidden=True,
    IncludeLocked=True,
    LayerFilter="layer_02",
    NameFilter="*",
    SublayerFiltering=True,
    TypeFilter=5)  # disabled
geometry_3 = GeometryPipeline(
    GroupByLayer=False,
    GroupByType=False,
    IncludeHidden=True,
    IncludeLocked=True,
    LayerFilter="layer_04",
    NameFilter="*",
    SublayerFiltering=True,
    TypeFilter=5)  # disabled
geometry_4 = GeometryPipeline(
    GroupByLayer=False,
    GroupByType=False,
    IncludeHidden=True,
    IncludeLocked=True,
    LayerFilter="layer_03",
    NameFilter="*",
    SublayerFiltering=True,
    TypeFilter=5)  # disabled
merge = Merge(Data1=geometry, Data2=geometry_2, Data3=geometry_4, Data4=geometry_3)  # -> flatten(Result); disabled

working_plane = WorkingPlanes({"XY-PLANE": 12, "XZ-PLANE": 13, "YZ-PLANE": 23}, selected="XY-PLANE")
boundary_conditions = GeometryPipeline(
    GroupByLayer=False,
    GroupByType=False,
    IncludeHidden=True,
    IncludeLocked=True,
    LayerFilter="bc",
    NameFilter="*",
    SublayerFiltering=True,
    TypeFilter=4)  # disabled
loads = GeometryPipeline(
    GroupByLayer=False,
    GroupByType=False,
    IncludeHidden=True,
    IncludeLocked=True,
    LayerFilter="load",
    NameFilter="*",
    SublayerFiltering=True,
    TypeFilter=4)  # disabled
element_type = ElementTypes({"TRUSS": 3, "BEAM": 6}, selected="TRUSS")
dimension = Dimension({"2D": 2, "3D": 3}, selected="2D")
python = GhPythonScript()  # -> path
# ---------- python: Python ----------
import os
path = os.path.dirname(ghenv.LocalScope.ghdoc.Path)
# ---------- end python ----------
preperation = PreperationForTopologyOptimization(
    Elements=merge,
    BoundaryConditions=boundary_conditions,
    Forces=loads,
    ElementType=element_type,
    WorkingPlane=working_plane,
    Dimension=dimension,
    Path=python)  # -> Nodes, Elements, Orientations, ElementSet, Layers, OutputFiles; disabled

filtering_approach = FilteringApproach({"SENS": 1, "DENS": 2}, selected="SENS")
set = AdvancedSettingsComponent(
    PenalizationFactor=3,
    MoveLimit=0.2,
    Tolerance=0.001,
    MaximumIterations=1000,
    FilteringApproach=filtering_approach,
    Continuation=False)
cross_section_height = Slider(1, range=0..2)
cross_section_witdh = Slider(1, range=0..10)
minimum_length = Slider(32, range=0..64)
volume_fraction = Slider(0.5, range=0..1)
run = RunTheTopologyOptimizationProgram(
    VolumeFraction=volume_fraction,
    MinimumLength=minimum_length,
    CrossSectionWidth=cross_section_witdh,
    CrossSectionHeight=cross_section_height,
    ElementType=element_type,
    Passive=False,
    AdvancedSettings=set,
    SaveDensities=Toggle(False),
    Path=python,
    Run=Button(),
    PythonCaller="python")

read = ReadTheTopologyOptimizationResults(FileLocation=python, Run=Toggle(True), Iteration=-1)  # -> Densities, ReadedFile

crv = Curve([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])
Y = UnitY(Factor=Slider(80, range=0..100))
Y_2 = UnitY(Factor=Slider(160, range=0..300))

# ----
# Figure black and white
threshold = Slider(0.5, range=0..1)
larger = LargerThan(FirstNumber=read.Densities, SecondNumber=threshold)  # -> LargerThan, OrEqualTo
cull = CullPattern(List=crv, CullPattern=larger.LargerThan)
line_thickness = Slider(0.2, range=0..10)

move = Move(Geometry=cull, Motion=Y)  # -> Geometry, Transform

previewlw = CustomPreviewLineweights(Geometry=move.Geometry, Shader=ColourSwatch(SwatchColor=RGB(0, 0, 0)), Thickness=line_thickness, Absolute=True)

# ----
# Figure gray scale
threshold_2 = Slider(0.01, range=0..1)
larger_2 = LargerThan(FirstNumber=read.Densities, SecondNumber=threshold_2)  # -> LargerThan, OrEqualTo
cull_2 = CullPattern(List=read.Densities, CullPattern=larger_2.LargerThan)
cull_3 = CullPattern(List=crv, CullPattern=larger_2.LargerThan)
gradient = Gradient(LowerLimit=0, UpperLimit=1, Parameter=cull_2, stops=[0: RGB(255, 255, 255), 1: RGB(0, 0, 0)])
line_thickness_2 = Slider(0.2, range=0..10)
multiplication = Multiplication(A=cull_2, B=line_thickness_2)

move_2 = Move(Geometry=cull_3, Motion=Y_2)  # -> Geometry, Transform

previewlw_2 = CustomPreviewLineweights(Geometry=move_2.Geometry, Shader=gradient, Thickness=multiplication, Absolute=True)
