# Grasshopper definition GRASSHOPPER.gh (Grasshopper 1.0.7)
# plug-ins: TopOpt-DMS2019, Human

working_plane = WorkingPlanes({"XY-PLANE": 12, "XZ-PLANE": 13, "YZ-PLANE": 23}, selected="XY-PLANE")
geometry = GeometryPipeline(
    GroupByLayer=False,
    GroupByType=False,
    IncludeHidden=True,
    IncludeLocked=True,
    LayerFilter="layer_01",
    NameFilter="*",
    SublayerFiltering=True,
    TypeFilter=5)  # disabled
geometry_2 = GeometryPipeline(
    GroupByLayer=False,
    GroupByType=False,
    IncludeHidden=True,
    IncludeLocked=True,
    LayerFilter="layer_05",
    NameFilter="*",
    SublayerFiltering=True,
    TypeFilter=5)  # disabled
geometry_3 = GeometryPipeline(
    GroupByLayer=False,
    GroupByType=False,
    IncludeHidden=True,
    IncludeLocked=True,
    LayerFilter="layer_02",
    NameFilter="*",
    SublayerFiltering=True,
    TypeFilter=5)  # disabled
geometry_4 = GeometryPipeline(
    GroupByLayer=False,
    GroupByType=False,
    IncludeHidden=True,
    IncludeLocked=True,
    LayerFilter="layer_06",
    NameFilter="*",
    SublayerFiltering=True,
    TypeFilter=5)  # disabled
geometry_5 = GeometryPipeline(
    GroupByLayer=False,
    GroupByType=False,
    IncludeHidden=True,
    IncludeLocked=True,
    LayerFilter="layer_04",
    NameFilter="*",
    SublayerFiltering=True,
    TypeFilter=5)  # disabled
geometry_6 = GeometryPipeline(
    GroupByLayer=False,
    GroupByType=False,
    IncludeHidden=True,
    IncludeLocked=True,
    LayerFilter="layer_03",
    NameFilter="*",
    SublayerFiltering=True,
    TypeFilter=5)  # disabled
geometry_7 = GeometryPipeline(
    GroupByLayer=False,
    GroupByType=False,
    IncludeHidden=True,
    IncludeLocked=True,
    LayerFilter="layer_08",
    NameFilter="*",
    SublayerFiltering=True,
    TypeFilter=5)  # disabled
geometry_8 = GeometryPipeline(
    GroupByLayer=False,
    GroupByType=False,
    IncludeHidden=True,
    IncludeLocked=True,
    LayerFilter="layer_07",
    NameFilter="*",
    SublayerFiltering=True,
    TypeFilter=5)  # disabled
boundary_conditions = GeometryPipeline(
    GroupByLayer=False,
    GroupByType=False,
    IncludeHidden=True,
    IncludeLocked=True,
    LayerFilter="bc",
    NameFilter="*",
    SublayerFiltering=True,
    TypeFilter=4)
loads = GeometryPipeline(
    GroupByLayer=False,
    GroupByType=False,
    IncludeHidden=True,
    IncludeLocked=True,
    LayerFilter="load",
    NameFilter="*",
    SublayerFiltering=True,
    TypeFilter=4)
element_type = ElementTypes({"TRUSS": 3, "BEAM": 6}, selected="TRUSS")
dimension = Dimension({"2D": 2, "3D": 3}, selected="2D")
python = GhPythonScript()  # -> path
# ---------- python: Python ----------
import os
path = os.path.dirname(ghenv.LocalScope.ghdoc.Path)
# ---------- end python ----------
merge = Merge(
    Data1=geometry,
    Data2=geometry_3,
    Data3=geometry_6,
    Data4=geometry_5,
    Data5=geometry_2,
    Data6=geometry_4,
    Data7=geometry_8,
    Data8=geometry_7)  # disabled
preperation = PreperationForTopologyOptimization(
    Elements=merge,
    BoundaryConditions=boundary_conditions,
    Forces=loads,
    ElementType=element_type,
    WorkingPlane=working_plane,
    Dimension=dimension,
    Path=python)  # -> Nodes, Elements, Orientations, ElementSet, Layers, OutputFiles; disabled

filtering_approach = FilteringApproach({"SENS": 1, "DENS": 2}, selected="SENS")
set = AdvancedSettingsComponent(
    PenalizationFactor=3,
    MoveLimit=0.2,
    Tolerance=0.001,
    MaximumIterations=1000,
    FilteringApproach=filtering_approach,
    Continuation=False)
cross_section_witdh = Slider(1, range=0..10)
cross_section_height = Slider(1, range=0..2)
minimum_length = Slider(32, range=0..64)
num = Number("0.2601788053")
run = RunTheTopologyOptimizationProgram(
    VolumeFraction=num,
    MinimumLength=minimum_length,
    CrossSectionWidth=cross_section_witdh,
    CrossSectionHeight=cross_section_height,
    ElementType=element_type,
    Passive=False,
    AdvancedSettings=set,
    SaveDensities=False,
    Path=python,
    Run=Button(),
    PythonCaller="python")

read = ReadTheTopologyOptimizationResults(FileLocation=python, Run=Toggle(True), Iteration=-1)  # -> Densities, ReadedFile

crv = Curve([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])

# ----
# Figure
threshold = Slider(0.01, range=0..1)
larger = LargerThan(FirstNumber=read.Densities, SecondNumber=threshold)  # -> LargerThan, OrEqualTo
cull = CullPattern(List=read.Densities, CullPattern=larger.LargerThan)
cull_2 = CullPattern(List=crv, CullPattern=larger.LargerThan)
gradient = Gradient(LowerLimit=0, UpperLimit=1, Parameter=cull, stops=[0: RGB(255, 255, 255), 1: RGB(0, 0, 0)])
line_thickness = Slider(0.2, range=0..10)
multiplication = Multiplication(A=cull, B=line_thickness)
previewlw = CustomPreviewLineweights(Geometry=cull_2, Shader=gradient, Thickness=multiplication, Absolute=True)

# ----
# Figure black and white
threshold_2 = Slider(0.5, range=0..1)
larger_2 = LargerThan(FirstNumber=read.Densities, SecondNumber=threshold_2)  # -> LargerThan, OrEqualTo
cull_3 = CullPattern(List=crv, CullPattern=larger_2.LargerThan)
line_thickness_2 = Slider(0.2, range=0..10)
previewlw_2 = CustomPreviewLineweights(Geometry=cull_3, Shader=ColourSwatch(SwatchColor=RGB(0, 0, 0)), Thickness=line_thickness_2, Absolute=True)
