# Grasshopper definition GRASSHOPPER.gh (Grasshopper 1.0.7)
# plug-ins: TopOpt-DMS2019, Human

# ----
# Additional grid lines
pipeline = GeometryPipeline(
    GroupByLayer=False,
    GroupByType=False,
    IncludeHidden=True,
    IncludeLocked=True,
    LayerFilter="layer_5",
    NameFilter="*",
    SublayerFiltering=True,
    TypeFilter=4)
pipeline_2 = GeometryPipeline(
    GroupByLayer=False,
    GroupByType=False,
    IncludeHidden=True,
    IncludeLocked=True,
    LayerFilter="layer_6",
    NameFilter="*",
    SublayerFiltering=True,
    TypeFilter=4)
pipeline_3 = GeometryPipeline(
    GroupByLayer=False,
    GroupByType=False,
    IncludeHidden=True,
    IncludeLocked=True,
    LayerFilter="layer_7",
    NameFilter="*",
    SublayerFiltering=True,
    TypeFilter=4)
pipeline_4 = GeometryPipeline(
    GroupByLayer=False,
    GroupByType=False,
    IncludeHidden=True,
    IncludeLocked=True,
    LayerFilter="layer_8",
    NameFilter="*",
    SublayerFiltering=True,
    TypeFilter=4)
merge = Merge(Data1=flatten(pipeline), Data2=flatten(pipeline_2), Data3=flatten(pipeline_3), Data4=flatten(pipeline_4))

# ----
# Basic grid
pipeline_5 = GeometryPipeline(
    GroupByLayer=False,
    GroupByType=False,
    IncludeHidden=True,
    IncludeLocked=True,
    LayerFilter="layer_1",
    NameFilter="*",
    SublayerFiltering=True,
    TypeFilter=4)
pipeline_6 = GeometryPipeline(
    GroupByLayer=False,
    GroupByType=False,
    IncludeHidden=True,
    IncludeLocked=True,
    LayerFilter="layer_2",
    NameFilter="*",
    SublayerFiltering=True,
    TypeFilter=4)
pipeline_7 = GeometryPipeline(
    GroupByLayer=False,
    GroupByType=False,
    IncludeHidden=True,
    IncludeLocked=True,
    LayerFilter="layer_3",
    NameFilter="*",
    SublayerFiltering=True,
    TypeFilter=4)
pipeline_8 = GeometryPipeline(
    GroupByLayer=False,
    GroupByType=False,
    IncludeHidden=True,
    IncludeLocked=True,
    LayerFilter="layer_4",
    NameFilter="*",
    SublayerFiltering=True,
    TypeFilter=4)
merge_2 = Merge(Data1=flatten(pipeline_5), Data2=flatten(pipeline_6), Data3=flatten(pipeline_7), Data4=flatten(pipeline_8))

working_plane = WorkingPlanes({"XY-PLANE": 12, "XZ-PLANE": 13, "YZ-PLANE": 23}, selected="XY-PLANE")

# ----
# Line supports
pipeline_9 = GeometryPipeline(
    GroupByLayer=False,
    GroupByType=False,
    IncludeHidden=True,
    IncludeLocked=True,
    LayerFilter="bc_line_3",
    NameFilter="*",
    SublayerFiltering=True,
    TypeFilter=4)
pipeline_10 = GeometryPipeline(
    GroupByLayer=False,
    GroupByType=False,
    IncludeHidden=True,
    IncludeLocked=True,
    LayerFilter="bc_line_4",
    NameFilter="*",
    SublayerFiltering=True,
    TypeFilter=4)
pipeline_11 = GeometryPipeline(
    GroupByLayer=False,
    GroupByType=False,
    IncludeHidden=True,
    IncludeLocked=True,
    LayerFilter="bc_line_1",
    NameFilter="*",
    SublayerFiltering=True,
    TypeFilter=4)
pipeline_12 = GeometryPipeline(
    GroupByLayer=False,
    GroupByType=False,
    IncludeHidden=True,
    IncludeLocked=True,
    LayerFilter="bc_line_2",
    NameFilter="*",
    SublayerFiltering=True,
    TypeFilter=4)

# ----
# Corner supports
pipeline_13 = GeometryPipeline(
    GroupByLayer=False,
    GroupByType=False,
    IncludeHidden=True,
    IncludeLocked=True,
    LayerFilter="bc_corners",
    NameFilter="*",
    SublayerFiltering=True,
    TypeFilter=4)

# ----
# Loads
pipeline_14 = GeometryPipeline(
    GroupByLayer=False,
    GroupByType=False,
    IncludeHidden=True,
    IncludeLocked=True,
    LayerFilter="load20",
    NameFilter="*",
    SublayerFiltering=True,
    TypeFilter=4)
pipeline_15 = GeometryPipeline(
    GroupByLayer=False,
    GroupByType=False,
    IncludeHidden=True,
    IncludeLocked=True,
    LayerFilter="load10",
    NameFilter="*",
    SublayerFiltering=True,
    TypeFilter=4)

element_type = ElementTypes({"TRUSS": 3, "BEAM": 6}, selected="BEAM")

# ----
# Total beam length of default grid
len = Length(Curve=merge_2)
ma = MassAddition(Input=len)  # -> Result, PartialResults
panel = Panel(ma.Result)

# ----
# Calculates the volume fraction for the extended grid
# Reference volume fraction
volume_fraction = Slider(0.3, range=0..1)

# ----
# Local file path
python = GhPythonScript()  # -> path
# ---------- python: Python ----------
import os
path = os.path.dirname(ghenv.LocalScope.ghdoc.Path)
# ---------- end python ----------
panel_2 = Panel(python)

dimension = Dimension({"2D": 2, "3D": 3}, selected="3D")
merge_3 = Merge(Data1=flatten(pipeline_15), Data2=flatten(pipeline_14))
merge_4 = Merge(
    Data1=flatten(pipeline_13),
    Data2=flatten(pipeline_11),
    Data3=flatten(pipeline_12),
    Data4=flatten(pipeline_9),
    Data5=flatten(pipeline_10))

# ----
# Reference beam length
expression = Expression(x=volume_fraction, y=panel, Expression="x*y")
panel_3 = Panel(expression)

merge_5 = Merge(Data1=flatten(merge_2), Data2=flatten(merge))

# ----
# Select grid
list = ValueList({"Grid 1": 0, "Grid 2": 1}, selected="Grid 1")
filter = StreamFilter(Gate=list, Stream0=merge_2, Stream1=merge_5)

# ----
# Total beam length of chosen grid
len_2 = Length(Curve=filter)
ma_2 = MassAddition(Input=len_2)  # -> Result, PartialResults
panel_4 = Panel(ma_2.Result)

# ----
# Select support
list_2 = ValueList({"Corner": 0, "Edge": 1}, selected="Corner")
filter_2 = StreamFilter(Gate=list_2, Stream0=pipeline_13, Stream1=merge_4)

# ----
# The real volume faction
expression_2 = Expression(x=panel_3, y=panel_4, Expression="x/y")
panel_5 = Panel(expression_2)

# ----
# Construct data
preperation = PreperationForTopologyOptimization(
    Elements=filter,
    BoundaryConditions=filter_2,
    Forces=merge_3,
    ElementType=element_type,
    WorkingPlane=working_plane,
    Dimension=dimension,
    Path=panel_2)  # -> Nodes, Elements, Orientations, ElementSet, Layers, OutputFiles

# ----
# Scan
button = Button()
scan = SearchScanAllTheTopologyOptimizationFiles(Path=panel_2, Scan=button)

# ----
# Advanced settings (optional)
number_slider = Slider(1000, range=0..1000)
filtering_approach = FilteringApproach({"SENS": 1, "DENS": 2}, selected="SENS")
set = AdvancedSettingsComponent(
    PenalizationFactor=Slider(3, range=1..5),
    MoveLimit=Slider(0.2, range=0..1),
    Tolerance=Slider(0.001, range=0..0.001),
    MaximumIterations=number_slider,
    FilteringApproach=filtering_approach,
    Continuation=Toggle(True))

# ----
# Delete (be carefull..)
button_2 = Button()
del = DeleteTheSelectedTopologyOptimizationFiles(Files=scan, Delete=button_2)  # -> DeletedFiles, Failed

# ----
# Find and delete all the saved files
panel_6 = Panel(scan)
panel_7 = Panel(del.DeletedFiles)
panel_8 = Panel(del.Failed)

num = Number(panel_5)

# ----
# Run the topology optimization program
number_slider_2 = Slider(0.3, range=0..10)
run = RunTheTopologyOptimizationProgram(
    VolumeFraction=num,
    MinimumLength=Slider(40, range=0..80),
    CrossSectionWidth=number_slider_2,
    CrossSectionHeight=Slider(1, range=0..10),
    ElementType=element_type,
    Passive=Toggle(False),
    AdvancedSettings=set,
    SaveDensities=Toggle(False),
    Path=panel_2,
    Run=Button(),
    PythonCaller="python")

# ----
# Read results (densities)
button_3 = Button()
read = ReadTheTopologyOptimizationResults(Path=panel_2, Run=button_3, Iteration=-1)  # -> Densities, ReadedFile

# ----
# Line visualization
move = Slider(160, range=0..1000)
line_thickness = Slider(30, range=0..100)
gradient = Gradient(LowerLimit=0, UpperLimit=1, Parameter=read.Densities, stops=[0: RGB(230, 230, 230), 1: RGB(0, 0, 0)])
X = UnitX(Factor=move)
expression_3 = Expression(x=read.Densities, y=line_thickness, Expression="x*y")
move_2 = Move(Geometry=preperation.Elements, Motion=X)  # -> Geometry, Transform
sort = SortList(Keys=expression_3, ValuesA=move_2.Geometry)  # -> Keys, ValuesA
sort_2 = SortList(Keys=expression_3, ValuesA=gradient)  # -> Keys, ValuesA
previewlw = CustomPreviewLineweights(Geometry=sort.ValuesA, Shader=sort_2.ValuesA, Thickness=sort.Keys, Absolute=False)

# ----
# 3D visualization (with black and white filter)
number_slider_3 = Slider(0.3, range=0..1)
pipeline_16 = GeometryPipeline(
    GroupByLayer=False,
    GroupByType=False,
    IncludeHidden=True,
    IncludeLocked=True,
    LayerFilter="edge",
    NameFilter="*",
    SublayerFiltering=True,
    TypeFilter=4)
move_3 = Move(Geometry=pipeline_16, Motion=expr("2*x", X))  # -> Geometry, Transform
larger = LargerThan(FirstNumber=read.Densities, SecondNumber=number_slider_3)  # -> LargerThan, OrEqualTo
move_4 = Move(Geometry=move_2.Geometry, Motion=X)  # -> Geometry, Transform
cull = CullPattern(List=move_4.Geometry, CullPattern=larger.LargerThan)
merge_6 = Merge(Data1=flatten(cull), Data2=flatten(move_3.Geometry))
Z = UnitZ(Factor=1)
vec = Vector(merge_6)
height = Slider(4, range=0..10)
xprod = CrossProduct(VectorA=vec, VectorB=Z, Unitize=False)  # -> Vector, Length
Z_2 = UnitZ(Factor=height)
extr = Extrude(Base=merge_6, Direction=Z_2)
amp = Amplitude(Vector=xprod.Vector, Amplitude=Slider(0.8, range=0..5))
extr_2 = Extrude(Base=extr, Direction=expr("-x", amp))
extr_3 = Extrude(Base=extr, Direction=amp)
merge_7 = Merge(Data1=extr_2, Data2=extr_3)
mesh = Mesh(merge_7)
mjoin = MeshJoin(Meshes=mesh)
preview = CustomPreview(Geometry=mjoin, Material=ColourSwatch(SwatchColor=RGB(168, 168, 168)))
